# Grasshopper definition API.WeatherData.Examples.gh (Grasshopper 1.0.7)
# plug-ins: ZymeToolbox.Grasshopper

# ----
# Use this component to query all the
# Weather Data Files provided by Climate.OneBuilding.Org
# 
# The index is built from the regional .kml files.
# You can download the files to your local disk (faster)
# Or let the component fetch it from the website (about 1 minute)
number_slider = Slider(289, range=0..500)
path = FilePath(["Z:\workflow\dev\github\ZBox\doc\OneBuilding\Region1_Africa_EPW_Processing_locations.kml", "Z:\workflow\dev\github\ZBox\doc\OneBuilding\Region2_Asia_EPW_Processing_locations.kml", "Z:\workflow\dev\github\ZBox\doc\OneBuilding\Region2_Region6_Russia_EPW_Processing_locations.kml", "Z:\workflow\dev\github\ZBox\doc\OneBuilding\Region3_South_America_EPW_Processing_locations.kml", "Z:\workflow\dev\github\ZBox\doc\OneBuilding\Region4_CaliforniaClimateZones_EPW_Processing_locations.kml", "Z:\workflow\dev\github\ZBox\doc\OneBuilding\Region4_Canada_EPW_Processing_locations.kml", "Z:\workflow\dev\github\ZBox\doc\OneBuilding\Region4_Canada_NRC_Future_EPW_Processing_locations.kml", "Z:\workflow\dev\github\ZBox\doc\OneBuilding\Region4_NA_CA_Caribbean_EPW_Processing_locations.kml", "Z:\workflow\dev\github\ZBox\doc\OneBuilding\Region4_USA_EPW_Processing_locations.kml", "Z:\workflow\dev\github\ZBox\doc\OneBuilding\Region5_Southwest_Pacific_EPW_Processing_locations.kml", "Z:\workflow\dev\github\ZBox\doc\OneBuilding\Region6_Europe_EPW_Processing_locations.kml", "Z:\workflow\dev\github\ZBox\doc\OneBuilding\Region7_Antarctica_EPW_Processing_locations.kml"])
ob_weather_dataindex = OneBuildingWeatherDataIndex(urls=path, filterTitle="TMYx", filterPtLatitude="45.73", filterPtLongitude="5.08", filterRadius=number_slider)  # -> WeatherDataTitle, WMOStationID, StationName, WMORegionID, DataSource, DataSet, Latitude, Longitude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
lng = ListLength(List=ob_weather_dataindex.WeatherDataTitle)
panel = Panel(ob_weather_dataindex.WeatherDataTitle)
panel_2 = Panel(lng)

# ----
# Use this component to query all the
# Weather Data Files provided by EneryPlus.Net
# 
# The index is built from the master.geojson file.
# You can download the file to your local disk (faster)
# Or let the component fetch it from the website.
number_slider_2 = Slider(0, range=0..500)
panel_3 = Panel("ITA")  # disabled
path_2 = FilePath("Z:\workflow\dev\github\ZBox\doc\DOE\master.geojson")
doe_weather_data_index = DOEWeatherDataIndex(url=path_2, filterTitle=panel_3, filterPtLatitude="45.73", filterPtLongitude="5.08", filterRadius=number_slider_2)  # -> WeatherDataTitle, WMOStationID, StationName, WMORegionID, CountryCode, ZoneCode, DataSource, Latitude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
lng_2 = ListLength(List=doe_weather_data_index.WeatherDataTitle)
panel_4 = Panel(doe_weather_data_index.WeatherDataTitle)
panel_5 = Panel(lng_2)

# ----
# Use this component to downoad a file from an url. It can be a ZIP file.
# You can ask the component to UNZIP the file to a subfolder.
item = ListItem(List=doe_weather_data_index.EPWURL, Index=0, Wrap=True)
panel_6 = Panel(item)
path_3 = FilePath("C:\Users\lionel\Desktop\DownloadEPW\")
download = DownloadFile(UrlToFile=panel_6, DirectoryPath=path_3, Overwrite=False, ExtractZIP=True, Run=Toggle(True))
panel_7 = Panel(download)
